test file "Debounce"
  coverage: Decision

suite "New Test Suite 1"

  case "New Test Case 1" [baseline]
    model test_modello, harness Debounce_Harness2 (for test_modello/Debounce)
    parameter set "Parameter Set 1" (off): Active_Scenario_Index = 1  % model workspace
    parameter set "Parameter Set 2" (off): Active_Scenario_Index = 2  % model workspace
    parameter set "Parameter Set 3": Active_Scenario_Index = 3  % model workspace
    iterations:
      Iteration1: ParameterSet "Parameter Set 1"
      Iteration2: ParameterSet "Parameter Set 2"
      Iteration3: ParameterSet "Parameter Set 3"