test file "IntegrationTests"
  coverage: Decision

suite "New Test Suite 1"

  case "New Test Case 1" [baseline]
    model test_modello, harness test_modello_Harness_Integration_Test (for test_modello/Fornello)
    test sequence scenario: Aumento_potenza_fornello (test_modello_Harness_Integration_Test/Test Sequence)
    parameter set "Parameter Set 1" (off): Active_Scenario_Index = 1  % model workspace
    parameter set "Parameter Set 2" (off): Active_Scenario_Index = 2  % model workspace
    parameter set "Parameter Set 3" (off): Active_Scenario_Index = 3  % model workspace
    parameter set "Parameter Set 4": Active_Scenario_Index = 4  % model workspace
    parameter set "Parameter Set 5" (off): Active_Scenario_Index = 5  % model workspace
    parameter set "Parameter Set 6" (off): Active_Scenario_Index = 6  % model workspace
    parameter set "Parameter Set 7" (off): Active_Scenario_Index = 7  % model workspace
    parameter set "Parameter Set 8" (off): Active_Scenario_Index = 8  % model workspace
    iterations:
      Iteration1: ParameterSet "Parameter Set 1", TestSequenceScenario "Aumento_potenza_fornello"
      Iteration2: ParameterSet "Parameter Set 2", TestSequenceScenario "Abbasso_potenza_fornello"
      Iteration3: ParameterSet "Parameter Set 3", TestSequenceScenario "Rimozione_pentola_entro_10s"
      Iteration4: ParameterSet "Parameter Set 4", TestSequenceScenario "Rimozione_pentola_maggiore_10s"
      Iteration5: ParameterSet "Parameter Set 5", TestSequenceScenario "Selezione_multipla"
      Iteration6: ParameterSet "Parameter Set 6", TestSequenceScenario "EdgeCase_Aumento_potenza_senza_pentola"
      Iteration7: ParameterSet "Parameter Set 7", TestSequenceScenario "EdgeCase_Selezione_oltre_limite"
      Iteration8: ParameterSet "Parameter Set 8", TestSequenceScenario "Caso_particolare"