test file "Selector"
  coverage: Decision

suite "New Test Suite 1"

  case "New Test Case 1" [baseline]
    model test_modello, harness Selector_Harness1 (for test_modello/Selector)
    test sequence scenario: Selezione_all_up_down (Selector_Harness1/Test Sequence)
    parameter set "Parameter Set 1": Active_Scenario_Index = 1  % model workspace
    parameter set "Parameter Set 2" (off): Active_Scenario_Index = 1  % model workspace
    parameter set "Parameter Set 3" (off): Active_Scenario_Index = 1  % model workspace
    parameter set "Parameter Set 4" (off): Active_Scenario_Index = 1  % model workspace
    iterations:
      Iteration1: ParameterSet "Parameter Set 1", TestSequenceScenario "Selezione_all_up_down"
      Iteration2: ParameterSet "Parameter Set 2", TestSequenceScenario "Scenario_max_up_low_limit"
      Iteration3: ParameterSet "Parameter Set 3", TestSequenceScenario "Scenario_rimozione_pentola"
      Iteration4: ParameterSet "Parameter Set 4", TestSequenceScenario "Scenario_disattiva"