test file "Watchdog"
  coverage: Decision

suite "New Test Suite 1"

  case "New Test Case 1" [baseline]
    model test_modello, harness Watchdog_Harness2 (for test_modello/Watchdog)
    parameter set "Parameter Set 1" (off): Active_Scenario_Index = 1  % model workspace
    parameter set "Parameter Set 2": Active_Scenario_Index = 2  % model workspace
    iterations:
      Iteration1: ParameterSet "Parameter Set 1"
      Iteration2: ParameterSet "Parameter Set 2"